# Dynamo graph slave.dyn (Dynamo 1.1.0.2094)

string = StringInput("C:\Users\gtalarico\Dropbox\Shared\dev\repos\project_sandwich\dynamo\out\out.txt")
number = DoubleInput(0)
number_2 = DoubleInput(10)
number_3 = DoubleInput(1)
range = Range(start=number, end=number_2, step=number_3, lacing=Longest)
writeToFile = CSV.WriteToFile(string, range)
